# Grasshopper definition allowing-disallowing-modules-in-certain-area.gh (Grasshopper 1.0.7)
# plug-ins: Monoceros

# Slot centers
pt = Point([Point(2, 2, 2), Point(3, 2, 2), Point(4, 2, 2), Point(5, 2, 2), Point(6, 2, 2), Point(7, 2, 2)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])
M = Module([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])
# "Selected" Modules can be
# placed only inside this BRep
brep = Brep(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)
# "Selected" Module indices
panel = Panel("""1
3""")
brepinc = PointInBrep(Brep=brep, Point=pt, Strict=False)
# List of Modules
# without the "selected" Modules
cull_i = CullIndex(List=M, Indices=panel, Wrap=True)
dispatch = Dispatch(List=pt, DispatchPattern=brepinc)  # -> ListA, ListB
graft = GraftTree(Tree=dispatch.ListB, IncludeEmptyLists=True, IncludeNullItems=True)
# Points inside the BRep
# for Slots allowing placement
# of the "selected" Modules
graft_2 = GraftTree(Tree=dispatch.ListA, IncludeEmptyLists=True, IncludeNullItems=True)
# Slots allowing placement
# of Modules without
# the "selected" Modules
slotmodules = ConstructSlotWithListedModulesAllowed(SlotPoint=graft, BasePlane=PlaneXY(0, 0, 0), GridSlotDiagonal=Vector(1, 1, 1), AllowedModuleNames=cull_i)
# Slots allowing placement
# of all Modules, including
# the "selected" Modules
slotmodules_2 = ConstructSlotWithListedModulesAllowed(SlotPoint=graft_2, BasePlane=PlaneXY(0, 0, 0), GridSlotDiagonal=Vector(1, 1, 1), AllowedModuleNames=M)
merge = Merge(Data1=slotmodules_2, Data2=slotmodules)
flatten = FlattenTree(Tree=merge, Path="{0}")
panel_2 = Panel(flatten)
