# Grasshopper definition disallowing-rules.gh (Grasshopper 1.0.7)
# plug-ins: Monoceros

panel = Panel("""module_1:0 = type_a
module_2:3 = type_a
module_3:3 = type_a""")
M = Module([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])
collectrules = CollectRules(Module=M, RulesAllowed=panel, RulesDisallowed="module_1:0 -> module_3:3")
panel_2 = Panel(collectrules)
