# Grasshopper definition empty-module-and-additional-explicit-rules.gh (Grasshopper 1.0.7)
# plug-ins: Monoceros

# ---- group: All Modules
moduleempty = ConstructEmptyModule(BasePlane="{2,-1,0}", ModulePartDiagonal=Vector(1, 1, 1))  # -> Module, Rules
M = Module([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])
merge = Merge(Data1=M, Data2=moduleempty.Module)

# ----
R = Rule([{ConnectorIndex=0, ConnectorType="type_a", IsExplicit=False, IsTyped=True, ModuleName="module_1"}, {ConnectorIndex=3, ConnectorType="type_a", IsExplicit=False, IsTyped=True, ModuleName="module_2"}, {ConnectorIndex=3, ConnectorType="type_a", IsExplicit=False, IsTyped=True, ModuleName="module_3"}])
crv = Curve(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)
ruleexpcrv = ExplicitRuleFromCurve(Modules=merge, ConnectionCurve=crv)

# ---- group: All manually assigned Rules
merge_2 = Merge(Data1=moduleempty.Rules, Data2=R, Data3=ruleexpcrv)  # -> flatten(Result)

# ----
ruleindiffunused = IndifferentRulesForUnusedConnectors(Module=merge, Rules=merge_2)  # -> flatten(Rules)

# ---- group: All Rules
merge_3 = Merge(Data1=ruleindiffunused, Data2=merge_2)

# ----
panel = Panel(merge_3)
