# Grasshopper definition example_01-mondieu.gh (Grasshopper 1.0.7)
# plug-ins: Monoceros

# ---- group: Slot dimensions
vec = VectorXYZ(XComponent=Slider(100, range=0..100), YComponent=Slider(100, range=0..100), ZComponent=Slider(100, range=0..100))  # -> Vector, Length

# ---- group: Modules
geo = Geometry([<curve referenced from the Rhino model> x12])
lng = ListLength(List=geo)
graft = GraftTree(Tree=geo, IncludeEmptyLists=True, IncludeNullItems=True)
series = Series(Start=0, Step=1, Count=lng)
int = Integer(graft(series))
popslots = PopulateGeometryWithSlotCenters(Geometry=graft, BasePlane=PlaneXY(0, 0, 0), GridSlotDiagonal=vec.Vector, Fill=2, Precision=0.5)
concat = Concatenate(FragmentA="module", FragmentB=int)
pipe = Pipe(Curve=graft, Radius=Slider(5, range=0..10), Caps=0)
constmodule = ConstructModule(Name=concat, SlotPoints=popslots, ProductionGeometry=pipe, BasePlane=PlaneXY(0, 0, 0), GridSlotDiagonal=vec.Vector)  # -> flatten(Module)

# ---- group: Rules
pt = Point([<point referenced from the Rhino model> x6])
pt_2 = Point([<point referenced from the Rhino model> x6])
pt_3 = Point([<point referenced from the Rhino model> x6])
pt_4 = Point([<point referenced from the Rhino model> x8])
pt_5 = Point([<point referenced from the Rhino model> x6])
ruleoutpt = RuleAllowOutFromPointTag(Modules=constmodule, PointTag=pt_4)
ruletyppt = TypedRuleFromPointTag(Modules=constmodule, PointTag=pt, ConnectorType="type-c")
ruletyppt_2 = TypedRuleFromPointTag(Modules=constmodule, PointTag=pt_3, ConnectorType="type-d")
ruletyppt_3 = TypedRuleFromPointTag(Modules=constmodule, PointTag=pt_2, ConnectorType="type-a")
ruletyppt_4 = TypedRuleFromPointTag(Modules=constmodule, PointTag=pt_5, ConnectorType="type-b")
merge = Merge(Data1=ruletyppt_3, Data2=ruletyppt_4, Data3=ruletyppt, Data4=ruletyppt_2, Data5=ruleoutpt)  # -> flatten(Result)
ruleindiffunused = RuleTypedIndifferentForUnusedConnectors(Module=constmodule, Rules=merge)
merge_2 = Merge(Data1=ruleindiffunused, Data2=merge)  # -> flatten(Result)

# ---- group: World
geo_2 = Geometry(<brep referenced from the Rhino model>)
popslots_2 = PopulateGeometryWithSlotCenters(Geometry=geo_2, BasePlane=PlaneXY(0, 0, 0), GridSlotDiagonal=vec.Vector, Fill=Slider(1, range=0..2), Precision=0.5)
slotall = ConstructSlotWithAllModulesAllowed(SlotPoint=popslots_2, BasePlane=PlaneXY(0, 0, 0), GridSlotDiagonal=vec.Vector)

# ---- group: Solver
wfc = MonocerosWFCSolver(Slots=slotall, Modules=constmodule, Rules=merge_2, RandomSeed=42, MaxAttempts=10)  # -> Out, Slots, Success, Attempts

# ----
panel = Panel(wfc.Out)

# ---- group: Materializer
materialize = MaterializeModule(Module=constmodule, Slots=wfc.Slots)  # -> Geometry, Transform
