# Grasshopper definition multiple-different-empty-modules.gh (Grasshopper 1.0.7)
# plug-ins: Monoceros

panel = Panel("""{2,2,0}
{3,2,0}
{4,2,0}""")
panel_2 = Panel("""{2,0,0}
{3,0,0}""")
constmodule = ConstructModule(Name="double_empty", ModulePartPoints=panel_2, BasePlane=PlaneXY(0, 0, 0), ModulePartDiagonal=Vector(1, 1, 1))
constmodule_2 = ConstructModule(Name="tripple_empty", ModulePartPoints=panel, BasePlane=PlaneXY(0, 0, 0), ModulePartDiagonal=Vector(1, 1, 1))
M = Module(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)
M_2 = Module(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)
ruleexp = ConstructExplicitRule(SourceModule=M, SourceConnectorIndex="0", TargetModule=constmodule, TargetConnectorIndex="2")
ruleexp_2 = ConstructExplicitRule(SourceModule=M_2, SourceConnectorIndex="0", TargetModule=constmodule_2, TargetConnectorIndex="2")
merge = Merge(Data1=ruleexp, Data2=ruleexp_2)
panel_3 = Panel(merge)
