# Grasshopper definition typed-rule-from-point-tag.gh (Grasshopper 1.0.7)
# plug-ins: Monoceros

M = Module(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)
pt = Point(Point(0.5, 0, 0))
ruletyppt = TypedRuleFromPoint(Modules=M, PointTag=pt, ConnectorType="type_b")
panel = Panel(ruletyppt)
